# Dynamo graph Offset Utilities using NSW Streets Opening Guidelines.dyn (Dynamo 2.5.1.7586)
# packages: Civil3DToolkit 1.1.30

select_utility_control_line_ca = ObjectSelection()  # 1 picked in the model; graph input
geometry = Autodesk.AutoCAD.DynamoNodes.Object.Geometry(object=select_utility_control_line_ca)
utilities_left_of_cl_separated = StringInput("HV@75-S@100-LV@100-W@150")  # "Utilities Left of CL (separated by "-", e.g. Gs@100-S@300-D@225)"; graph input
utility_type_gs_gm_gb_cm_lv_hv = StringInput("Gm@100")  # "Utility Type (Gs, Gm, Gb, CM, LV, HV, eHV, W, S, SW, NONE)"; graph input
utilities_right_of_cl_separated = StringInput("S@100-HV@75-LV@100-SW@300")  # "Utilities Right of CL (separated by "-", e.g. Gs@100-S@300-D@225)"; graph input
python_check_for_required_offset = Python(IN[0]=utilities_left_of_cl_separated, IN[1]=utility_type_gs_gm_gb_cm_lv_hv, IN[2]=utilities_right_of_cl_separated)  # "Python - Check for Required Offset Distances"
# ---------- python_check_for_required_offset.python (154 lines) ----------
# Load the Python Standard and DesignScript Libraries
import sys
import clr
import re # regex to enable split using multiple delimeter

# The inputs to this node will be stored as a list in the IN variables.
utilLeft = IN[0].upper()
utilOrigin = IN[1]
utilRight = IN[2].upper()

# break apart the utility type and diamter
utilOriginType = utilOrigin.split("@")
utilOriginDia = utilOriginType[1]
utilOriginType = utilOriginType[0]

# break apart the left and right utilities and set the offset sequence
utilLeftList, utilRightList = [], []
utilLeftDia, utilRightDia = [], []
offsetLeftList, offsetRightList = [], []

# item will have a syntax of type@diameter (e.g. SW@225-S@100)
utilLeftList = re.split('-|@', utilLeft)
utilLeftDia = utilLeftList

utilLeftList = utilLeftList[::2]
utilLeftDia = utilLeftDia[1::2]
utilLeftList.reverse()
utilLeftDia.reverse()

# item will have a syntax of type@diameter (e.g. SW@225-S@100)
utilRightList = re.split('-|@', utilRight)
utilRightDia = utilRightList

utilRightList = utilRightList[::2]
utilRightDia = utilRightDia[1::2]

# n are prime numbers assigned to each utilities to generate unique pairings/products
utilCode = {
	"gs": 2,
	"gm": 3,
	"gb": 5,
	"cm": 7,
	"lv": 11,
	"hv": 13,
	"ehv": 17,
	"w": 19,
	"s": 23,
	"sw": 29
}

# create a unique product dictionary with their corresponding required offset
utilClearance = {
    "P4":150,
    "P6":300,
    "P9":300,
    "P10":500,
    "P14":150,
    "P15":500,
    "P21":300,
    "P22":150,
    "P25":500,
    "P26":300,
    "P33":300,
    "P34":500,
    "P35":500,
    "P38":150,
    "P39":300,
    "P46":300,
    "P49":100,
    "P51":4000,
    "P55":500,
    "P57":150,
    "P58":300,
    "P65":500,
    "P69":300,
    "P77":100,
    "P85":4000,
    "P87":300,
    "P91":300,
    "P95":150,
    "P115":300,
    "P119":1000,
    "P121":1000,
    "P133":150,
    "P143":1000,
    "P145":300,
    "P161":300,
    "P169":1000,
    "P187":1000,
    "P203":300,
    "P209":1000,
    "P221":1000,
    "P247":1000,
    "P253":500,
    "P289":1000,
    "P299":500,
    "P319":300,
    "P323":2000,
    "P361":300,
    "P377":300,
    "P391":1000,
    "P437":500,
    "P493":1000,
    "P529":300,
    "P551":500,
    "P667":300,
    "P841":300
}

# declare iterative variables
utilCL, utilNext = 0, 0
utilOffset = 0

# offsetting left utilities from the control line
# check the iterating control line (utilCL)

if utilLeft != "NONE":
	# Left utilities
	for i in range(len(utilLeftList)):
		if i == 0:
			utilCL = utilCode[utilOriginType.lower()]
			utilNext =  utilCode[utilLeftList[0].lower()]
			utilProduct = utilCL*utilNext
			utilOffset = utilClearance["P" + str(utilProduct)]
			utilOffset = utilOffset + int(utilLeftDia[0])/2 + int(utilOriginDia)/2
		else:
			utilCL =  utilCode[utilLeftList[i-1].lower()]
			utilNext =  utilCode[utilLeftList[i].lower()]
			utilProduct = utilCL*utilNext
			utilOffset = utilClearance["P" + str(utilProduct)]
			# add half diameters from both utilities
			utilOffset = utilOffset + int(utilLeftDia[i])/2 + int(utilLeftDia[i-1])/2
		offsetLeftList.append(utilOffset)

if utilRight != "NONE":
	# Right utilities
	for i in range(len(utilRightList)):
		if i == 0:
			utilCL = utilCode[utilOriginType.lower()]
			utilNext =  utilCode[utilRightList[0].lower()]
			utilProduct = utilCL*utilNext
			utilOffset = utilClearance["P" + str(utilProduct)]
			utilOffset = utilOffset + int(utilRightDia[0])/2 + int(utilOriginDia)/2
		else:
			utilCL =  utilCode[utilRightList[i-1].lower()]
			utilNext =  utilCode[utilRightList[i].lower()]
			utilProduct = utilCL*utilNext
			utilOffset = utilClearance["P" + str(utilProduct)]
			# add half diameters from both utilities
			utilOffset = utilOffset + int(utilRightDia[i])/2 + int(utilRightDia[i-1])/2
		offsetRightList.append(utilOffset)

# Output the offset distances as lists
OUT = [utilLeftList, offsetLeftList, utilLeftDia, utilRightList, offsetRightList, utilRightDia, utilOriginType, utilOriginDia]
# ----------------------------------------
left_utilities_offset_distance = CodeBlock(i=python_check_for_required_offset) { i[1]; }  # "Left Utilities Offset Distance (Rel)"
left_utilities_offset_distance_2 = Python(IN[0]=left_utilities_offset_distance)  # "Left Utilities Offset Distance (from CL)"
# ---------- left_utilities_offset_distance_2.python (16 lines) ----------
# Load the Python Standard and DesignScript Libraries
import sys
import clr

offset = IN[0]
offsetList = []

total = 0

for i in range(len(offset)):
	total += offset[i]
	# set to negative to nominate the left side
	offsetList.append(total*-1)

# Assign your output to the OUT variable.
OUT = offsetList
# ----------------------------------------
convert_between_units = DynamoConvert(left_utilities_offset_distance_2, MeasurementType="Length", FromConversion="Millimeters", ToConversion="Meters")
current = Autodesk.AutoCAD.DynamoNodes.Document.Current()
modelSpace = Autodesk.AutoCAD.DynamoNodes.Document.ModelSpace(document=current)
offset = Autodesk.AutoCAD.DynamoNodes.PolylineExtensions.Offset(polyline=select_utility_control_line_ca, offset=convert_between_units, block=modelSpace)
left_utilities = CodeBlock(i=python_check_for_required_offset) { i[0]; }
setLayer = Autodesk.AutoCAD.DynamoNodes.Object.SetLayer(object=offset, layer=left_utilities)
right_utilities_offset_distance = CodeBlock(i=python_check_for_required_offset) { i[4]; }  # "Right Utilities Offset Distance (Rel)"
right_utilities_offset_distance_2 = Python(IN[0]=right_utilities_offset_distance)  # "Right Utilities Offset Distance (from CL)"
# ---------- right_utilities_offset_distance_2.python (15 lines) ----------
# Load the Python Standard and DesignScript Libraries
import sys
import clr

offset = IN[0]
offsetList = []

total = 0

for i in range(len(offset)):
	total += offset[i]
	offsetList.append(total)

# Assign your output to the OUT variable.
OUT = offsetList
# ----------------------------------------
convert_between_units_2 = DynamoConvert(right_utilities_offset_distance_2, MeasurementType="Length", FromConversion="Millimeters", ToConversion="Meters")
offset_2 = Autodesk.AutoCAD.DynamoNodes.PolylineExtensions.Offset(polyline=select_utility_control_line_ca, offset=convert_between_units_2, block=modelSpace)
right_utilities = CodeBlock(i=python_check_for_required_offset) { i[3]; }
setLayer_2 = Autodesk.AutoCAD.DynamoNodes.Object.SetLayer(object=offset_2, layer=right_utilities)
python_set_the_polyline_global = Python()  # "Python - Set the Polyline Global Widths"; frozen; unwired: IN[0], IN[1]
# ---------- python_set_the_polyline_global.python (50 lines) ----------
# Load the Python Standard and DesignScript Libraries
import sys
import clr

# Add Assemblies for AutoCAD and Civil3D
clr.AddReference('AcMgd')
clr.AddReference('AcCoreMgd')
clr.AddReference('AcDbMgd')
clr.AddReference('AecBaseMgd')
clr.AddReference('AecPropDataMgd')
clr.AddReference('AeccDbMgd')

# Import references from AutoCAD
from Autodesk.AutoCAD.Runtime import *
from Autodesk.AutoCAD.ApplicationServices import *
from Autodesk.AutoCAD.EditorInput import *
from Autodesk.AutoCAD.DatabaseServices import *
from Autodesk.AutoCAD.Geometry import *

# Import references from Civil3D
from Autodesk.Civil.ApplicationServices import *
from Autodesk.Civil.DatabaseServices import *

# Import references for PropertySets
from Autodesk.Aec.PropertyData import *
from Autodesk.Aec.PropertyData.DatabaseServices import *

# The inputs to this node will be stored as a list in the IN variables.
offsetedUtilities = IN[0]
diaUtilities = IN[1]

adoc = Application.DocumentManager.MdiActiveDocument
editor = adoc.Editor

with adoc.LockDocument():
	with adoc.Database as db:
		with db.TransactionManager.StartTransaction() as t:
            
			bt = t.GetObject(db.BlockTableId, OpenMode.ForRead)
			
			btr = t.GetObject(bt[BlockTableRecord.ModelSpace], OpenMode.ForWrite)
			
			for oid in offsetedUtilities:
				obj = t.GetObject(oid, OpenMode.ForWrite)
				obj.Layer = "0"
			# Commit before end transaction
			t.Commit()

# Assign your output to the OUT variable.
OUT = 0
# ----------------------------------------
polyline_parameter = StringInput("Thickness")
left_utilities_diameter_mm = CodeBlock(i=python_check_for_required_offset) { i[2]; }
string_to_int = Python(IN[0]=left_utilities_diameter_mm)
# ---------- string_to_int.python (12 lines) ----------
# Load the Python Standard and DesignScript Libraries
import sys
import clr

leftDiaString = IN[0]
leftDiaInt = []

for i in leftDiaString:
	leftDiaInt.append(int(i))

# Assign your output to the OUT variable.
OUT = leftDiaInt
# ----------------------------------------
convert_between_units_3 = DynamoConvert(string_to_int, MeasurementType="Length", FromConversion="Millimeters", ToConversion="Meters")
setParameterValueByName = Autodesk.AutoCAD.DynamoNodes.ObjectExtensions.SetParameterValueByName(obj=offset, parameter=polyline_parameter, value=convert_between_units_3)
right_utilities_diameter_mm = CodeBlock(i=python_check_for_required_offset) { i[5]; }
string_to_int_2 = Python(IN[0]=right_utilities_diameter_mm)  # same code as string_to_int
convert_between_units_4 = DynamoConvert(string_to_int_2, MeasurementType="Length", FromConversion="Millimeters", ToConversion="Meters")
setParameterValueByName_2 = Autodesk.AutoCAD.DynamoNodes.ObjectExtensions.SetParameterValueByName(obj=offset_2, parameter=polyline_parameter, value=convert_between_units_4)
